# Dynamo graph office.dyn (Dynamo 4.0.2.3852)

spatial_data_extraction = Python()  # PythonNet3; unwired: IN[0]
# ---------- spatial_data_extraction.python (163 lines) ----------
import clr
clr.AddReference('RevitAPI')
clr.AddReference('RevitServices')
from Autodesk.Revit.DB import *
from RevitServices.Persistence import DocumentManager

doc = DocumentManager.Instance.CurrentDBDocument

BASE_PATH = r"C:\Users\anany\OneDrive\Desktop\CMU\S26\Job Apps\KUNZ\kunz_demo\office\\"

import os
os.makedirs(BASE_PATH, exist_ok=True)

# ── ROOMS ────────────────────────────────────────────────
room_collector = FilteredElementCollector(doc)\
    .OfCategory(BuiltInCategory.OST_Rooms)\
    .ToElements()

room_rows = []
for r in room_collector:
    try:
        if r.Area == 0:
            continue
        name = r.get_Parameter(
            BuiltInParameter.ROOM_NAME
        ).AsString()
        number = r.get_Parameter(
            BuiltInParameter.ROOM_NUMBER
        ).AsString()
        area = round(r.Area * 0.092903, 2)
        perimeter = round(
            r.get_Parameter(
                BuiltInParameter.ROOM_PERIMETER
            ).AsDouble() * 0.3048, 2
        )
        level = doc.GetElement(r.LevelId).Name
        room_rows.append(
            f"{name},{number},{area},{perimeter},{level}"
        )
    except:
        continue

with open(BASE_PATH + "rooms.csv", 'w', encoding='utf-8') as f:
    f.write("Name,Number,Area_m2,Perimeter_m,Level\n")
    for row in room_rows:
        f.write(row + "\n")

# ── WALLS ────────────────────────────────────────────────
wall_collector = FilteredElementCollector(doc)\
    .OfCategory(BuiltInCategory.OST_Walls)\
    .ToElements()

wall_rows = []
for w in wall_collector:
    try:
        name = w.Name
        length_param = w.get_Parameter(
            BuiltInParameter.CURVE_ELEM_LENGTH
        )
        length = round(
            length_param.AsDouble() * 0.3048, 2
        ) if length_param else 0
        
        area_param = w.get_Parameter(
            BuiltInParameter.HOST_AREA_COMPUTED
        )
        area = round(
            area_param.AsDouble() * 0.092903, 2
        ) if area_param else 0
        
        level = doc.GetElement(w.LevelId)
        level_name = level.Name if level else "Unknown"
        
        wall_rows.append(
            f"{name},{length},{area},{level_name}"
        )
    except:
        continue

with open(BASE_PATH + "walls.csv", 'w', encoding='utf-8') as f:
    f.write("Type,Length_m,Area_m2,Level\n")
    for row in wall_rows:
        f.write(row + "\n")

# ── FLOORS ───────────────────────────────────────────────
floor_collector = FilteredElementCollector(doc)\
    .OfCategory(BuiltInCategory.OST_Floors)\
    .ToElements()

floor_rows = []
for fl in floor_collector:
    try:
        name = fl.Name
        area_param = fl.get_Parameter(
            BuiltInParameter.HOST_AREA_COMPUTED
        )
        area = round(
            area_param.AsDouble() * 0.092903, 2
        ) if area_param else 0
        
        level = doc.GetElement(fl.LevelId)
        level_name = level.Name if level else "Unknown"
        
        floor_rows.append(f"{name},{area},{level_name}")
    except:
        continue

with open(BASE_PATH + "floors.csv", 'w', encoding='utf-8') as f:
    f.write("Type,Area_m2,Level\n")
    for row in floor_rows:
        f.write(row + "\n")

# ── DOORS ────────────────────────────────────────────────
door_collector = FilteredElementCollector(doc)\
    .OfCategory(BuiltInCategory.OST_Doors)\
    .ToElements()

door_rows = []
for d in door_collector:
    try:
        if d.GetType().Name == "FamilySymbol":
            continue
        name = d.Name
        level = doc.GetElement(d.LevelId)
        level_name = level.Name if level else "Unknown"
        door_rows.append(f"{name},{level_name}")
    except:
        continue

with open(BASE_PATH + "doors.csv", 'w', encoding='utf-8') as f:
    f.write("Type,Level\n")
    for row in door_rows:
        f.write(row + "\n")

# ── WINDOWS ──────────────────────────────────────────────
window_collector = FilteredElementCollector(doc)\
    .OfCategory(BuiltInCategory.OST_Windows)\
    .ToElements()

window_rows = []
for w in window_collector:
    try:
        if w.GetType().Name == "FamilySymbol":
            continue
        name = w.Name
        level = doc.GetElement(w.LevelId)
        level_name = level.Name if level else "Unknown"
        window_rows.append(f"{name},{level_name}")
    except:
        continue

with open(BASE_PATH + "windows.csv", 'w', encoding='utf-8') as f:
    f.write("Type,Level\n")
    for row in window_rows:
        f.write(row + "\n")

OUT = [
    f"Rooms: {len(room_rows)}",
    f"Walls: {len(wall_rows)}",
    f"Floors: {len(floor_rows)}",
    f"Doors: {len(door_rows)}",
    f"Windows: {len(window_rows)}"
]
# ----------------------------------------
watch = Watch(spatial_data_extraction)
material_info_extraction = Python()  # PythonNet3; unwired: IN[0]
# ---------- material_info_extraction.python (85 lines) ----------
import clr
clr.AddReference('RevitAPI')
clr.AddReference('RevitServices')
from Autodesk.Revit.DB import *
from RevitServices.Persistence import DocumentManager

doc = DocumentManager.Instance.CurrentDBDocument

BASE_PATH = r"C:\Users\anany\OneDrive\Desktop\CMU\S26\Job Apps\KUNZ\kunz_demo\office\\"

# ── WALL MATERIAL EXTRACTION ─────────────────────────────
wall_collector = FilteredElementCollector(doc)\
    .OfCategory(BuiltInCategory.OST_Walls)\
    .ToElements()

material_rows = []

for wall in wall_collector:
    try:
        # Get wall area
        area_param = wall.get_Parameter(
            BuiltInParameter.HOST_AREA_COMPUTED
        )
        wall_area = area_param.AsDouble() * 0.092903 \
            if area_param else 0

        if wall_area == 0:
            continue

        # Get level
        level = doc.GetElement(wall.LevelId)
        level_name = level.Name if level else "Unknown"

        # Get wall type name
        wall_type = doc.GetElement(wall.GetTypeId())
        wall_type_name = wall_type.Name \
            if wall_type else "Unknown"

        # Get compound structure layers
        compound = wall_type.GetCompoundStructure()
        if compound is None:
            continue

        layers = compound.GetLayers()
        for layer in layers:
            mat_id = layer.MaterialId
            if mat_id == ElementId.InvalidElementId:
                continue

            mat = doc.GetElement(mat_id)
            if not mat:
                continue

            # Layer thickness in meters
            thickness = layer.Width * 0.3048

            if thickness == 0:
                continue

            # Volume = wall area × layer thickness
            volume = round(wall_area * thickness, 4)

            material_rows.append(
                f"{mat.Name},{wall_type_name},"
                f"{level_name},{round(wall_area,2)},"
                f"{round(thickness,3)},{volume}"
            )

    except:
        continue

with open(
    BASE_PATH + "wall_materials.csv", 'w', encoding='utf-8'
) as f:
    f.write(
        "Material,Wall_Type,Level,"
        "Wall_Area_m2,Thickness_m,Volume_m3\n"
    )
    for row in material_rows:
        f.write(row + "\n")

OUT = [
    f"Material rows extracted: {len(material_rows)}",
    "Saved to wall_materials.csv"
]
# ----------------------------------------
watch_2 = Watch(material_info_extraction)
